# Dynamo graph List Operations.dyn (Dynamo 0.7.1.17276)

join = List.Join()
code_block = CodeBlock { "D"; }
code_block_2 = CodeBlock { "E"; }
code_block_3 = CodeBlock { "F"; }
create = List.Create(code_block, code_block_2, code_block_3)
code_block_4 = CodeBlock { "A"; }
code_block_5 = CodeBlock { "B"; }
code_block_6 = CodeBlock { "C"; }
create_2 = List.Create(code_block_4, code_block_5, code_block_6)
combine = List.Combine(join, create, create_2)
create_3 = List.Create(create, create_2)
code_block_7 = CodeBlock { 1; }
getItemAtIndex = List.GetItemAtIndex(arg1=code_block_7)
sortByKey = SortByKey(create_3, getItemAtIndex)
code_block_8 = CodeBlock(LIST=create_3) { first_item = LIST[0]; }
