# Dynamo graph Dyson Sports Facility Structure.dyn (Dynamo 0.7.5.3881)

code_block = CodeBlock { 20.5; 0.0; 0.0; }
byCoordinates = Point.ByCoordinates(code_block.out0, code_block.out1, code_block.out2)
code_block_2 = CodeBlock { 20.39924; 0; 0.997273; }
byCoordinates_2 = Point.ByCoordinates(code_block_2.out0, code_block_2.out1, code_block_2.out2)
code_block_3 = CodeBlock { 20.101032; 0; 1.954235; }
byCoordinates_3 = Point.ByCoordinates(code_block_3.out0, code_block_3.out1, code_block_3.out2)
byThreePoints = Arc.ByThreePoints(byCoordinates, byCoordinates_2, byCoordinates_3)
code_block_4 = CodeBlock { 1.2; }
offset = Curve.Offset(byThreePoints, code_block_4)
code_block_5 = CodeBlock { 21.647698074; 0.750; -21.647698047; }
byCoordinates_4 = Point.ByCoordinates(code_block_5.out0, arg2=code_block_5.out1)
parameterAtPoint = Curve.ParameterAtPoint(offset, byCoordinates_4)
parameterTrimSegments = Curve.ParameterTrimSegments(offset, parameterAtPoint)
code_block_6 = CodeBlock { 19.64116; 0; 2.853931; }
byCoordinates_5 = Point.ByCoordinates(code_block_6.out0, code_block_6.out1, code_block_6.out2)
code_block_7 = CodeBlock { 19.06066; 0; 3.680947; }
byCoordinates_6 = Point.ByCoordinates(code_block_7.out0, code_block_7.out1, code_block_7.out2)
byThreePoints_2 = Arc.ByThreePoints(byCoordinates_3, byCoordinates_5, byCoordinates_6)
code_block_8 = CodeBlock { 18.084543; 0.0; 4.723916; }
byCoordinates_7 = Point.ByCoordinates(code_block_8.out0, code_block_8.out1, code_block_8.out2)
code_block_9 = CodeBlock { 16.97147; 0.0; 5.619268; }
byCoordinates_8 = Point.ByCoordinates(code_block_9.out0, code_block_9.out1, code_block_9.out2)
byThreePoints_3 = Arc.ByThreePoints(byCoordinates_6, byCoordinates_7, byCoordinates_8)
code_block_10 = CodeBlock { 15.761365; 0.0; 6.39255; }
byCoordinates_9 = Point.ByCoordinates(code_block_10.out0, code_block_10.out1, code_block_10.out2)
code_block_11 = CodeBlock { 14.495689; 0.0; 7.071068; }
byCoordinates_10 = Point.ByCoordinates(code_block_11.out0, code_block_11.out1, code_block_11.out2)
byThreePoints_4 = Arc.ByThreePoints(byCoordinates_8, byCoordinates_9, byCoordinates_10)
code_block_12 = CodeBlock { 11.096947; 0.0; 8.412447; }
byCoordinates_11 = Point.ByCoordinates(code_block_12.out0, code_block_12.out1, code_block_12.out2)
code_block_13 = CodeBlock { 9.333311; 0.0; 8.902756; }
byCoordinates_12 = Point.ByCoordinates(code_block_13.out0, code_block_13.out1, code_block_13.out2)
code_block_14 = CodeBlock { 7.545942; 0.0; 9.297883; }
byCoordinates_13 = Point.ByCoordinates(code_block_14.out0, code_block_14.out1, code_block_14.out2)
byThreePoints_5 = Arc.ByThreePoints(byCoordinates_11, byCoordinates_12, byCoordinates_13)
code_block_15 = CodeBlock { 5.674747; 0.0; 9.610661; }
byCoordinates_14 = Point.ByCoordinates(code_block_15.out0, code_block_15.out1, code_block_15.out2)
code_block_16 = CodeBlock { 3.790196; 0.0; 9.828976; }
byCoordinates_15 = Point.ByCoordinates(code_block_16.out0, code_block_16.out1, code_block_16.out2)
byThreePoints_6 = Arc.ByThreePoints(byCoordinates_13, byCoordinates_14, byCoordinates_15)
code_block_17 = CodeBlock { 0.0; 0.0; 10.0; }
byCoordinates_16 = Point.ByCoordinates(code_block_17.out0, code_block_17.out1, code_block_17.out2)
code_block_18 = CodeBlock { -3.790196; 0.0; 9.828976; }
byCoordinates_17 = Point.ByCoordinates(code_block_18.out0, code_block_18.out1, code_block_18.out2)
byThreePoints_7 = Arc.ByThreePoints(byCoordinates_15, byCoordinates_16, byCoordinates_17)
code_block_19 = CodeBlock { -5.674747; 0.0; 9.610661; }
byCoordinates_18 = Point.ByCoordinates(code_block_19.out0, code_block_19.out1, code_block_19.out2)
code_block_20 = CodeBlock { -7.545942; 0.0; 9.297883; }
byCoordinates_19 = Point.ByCoordinates(code_block_20.out0, code_block_20.out1, code_block_20.out2)
byThreePoints_8 = Arc.ByThreePoints(byCoordinates_17, byCoordinates_18, byCoordinates_19)
code_block_21 = CodeBlock { -9.333311; 0.0; 8.902756; }
byCoordinates_20 = Point.ByCoordinates(code_block_21.out0, code_block_21.out1, code_block_21.out2)
code_block_22 = CodeBlock { -11.096947; 0.0; 8.412447; }
byCoordinates_21 = Point.ByCoordinates(code_block_22.out0, code_block_22.out1, code_block_22.out2)
byThreePoints_9 = Arc.ByThreePoints(byCoordinates_19, byCoordinates_20, byCoordinates_21)
code_block_23 = CodeBlock { -14.495689; 0.0; 7.071068; }
byCoordinates_22 = Point.ByCoordinates(code_block_23.out0, code_block_23.out1, code_block_23.out2)
code_block_24 = CodeBlock { -15.761365; 0.0; 6.39255; }
byCoordinates_23 = Point.ByCoordinates(code_block_24.out0, code_block_24.out1, code_block_24.out2)
code_block_25 = CodeBlock { -16.97147; 0.0; 5.619268; }
byCoordinates_24 = Point.ByCoordinates(code_block_25.out0, code_block_25.out1, code_block_25.out2)
byThreePoints_10 = Arc.ByThreePoints(byCoordinates_22, byCoordinates_23, byCoordinates_24)
code_block_26 = CodeBlock { -18.084543; 0.0; 4.723916; }
byCoordinates_25 = Point.ByCoordinates(code_block_26.out0, code_block_26.out1, code_block_26.out2)
code_block_27 = CodeBlock { -19.06066; 0; 3.680947; }
byCoordinates_26 = Point.ByCoordinates(code_block_27.out0, code_block_27.out1, code_block_27.out2)
byThreePoints_11 = Arc.ByThreePoints(byCoordinates_24, byCoordinates_25, byCoordinates_26)
create = List.Create(byThreePoints_2, byThreePoints_3, byThreePoints_4, byThreePoints_5, byThreePoints_6, byThreePoints_7, byThreePoints_8, byThreePoints_9, byThreePoints_10, byThreePoints_11)
code_block_28 = CodeBlock { 1.2; }
offset_2 = Curve.Offset(create, code_block_28)
code_block_29 = CodeBlock { 12.822468; 0.0; 7.808017; }
byCoordinates_27 = Point.ByCoordinates(code_block_29.out0, code_block_29.out1, code_block_29.out2)
byThreePoints_12 = Arc.ByThreePoints(byCoordinates_10, byCoordinates_27, byCoordinates_11)
code_block_30 = CodeBlock { -12.822468; 0.0; 7.808017; }
byCoordinates_28 = Point.ByCoordinates(code_block_30.out0, code_block_30.out1, code_block_30.out2)
byThreePoints_13 = Arc.ByThreePoints(byCoordinates_21, byCoordinates_28, byCoordinates_22)
code_block_31 = CodeBlock { -19.64116; 0; 2.853931; }
byCoordinates_29 = Point.ByCoordinates(code_block_31.out0, code_block_31.out1, code_block_31.out2)
code_block_32 = CodeBlock { -20.101032; 0; 1.954235; }
byCoordinates_30 = Point.ByCoordinates(code_block_32.out0, code_block_32.out1, code_block_32.out2)
byThreePoints_14 = Arc.ByThreePoints(byCoordinates_26, byCoordinates_29, byCoordinates_30)
create_2 = List.Create(byThreePoints_12, byThreePoints_13, byThreePoints_14)
code_block_33 = CodeBlock { -1.2; }
offset_3 = Curve.Offset(create_2, code_block_33)
code_block_34 = CodeBlock { -20.39924; 0; 0.997273; }
byCoordinates_31 = Point.ByCoordinates(code_block_34.out0, code_block_34.out1, code_block_34.out2)
code_block_35 = CodeBlock { -20.5; 0.0; 0.0; }
byCoordinates_32 = Point.ByCoordinates(code_block_35.out0, code_block_35.out1, code_block_35.out2)
byThreePoints_15 = Arc.ByThreePoints(byCoordinates_30, byCoordinates_31, byCoordinates_32)
code_block_36 = CodeBlock { 1.2; }
offset_4 = Curve.Offset(byThreePoints_15, code_block_36)
reverse = Curve.Reverse(offset_4)
byCoordinates_33 = Point.ByCoordinates(code_block_5.out2, arg2=code_block_5.out1)
parameterAtPoint_2 = Curve.ParameterAtPoint(reverse, byCoordinates_33)
parameterTrimSegments_2 = Curve.ParameterTrimSegments(reverse, parameterAtPoint_2)
join = List.Join(parameterTrimSegments, offset_2, offset_3, parameterTrimSegments_2)
flatten = Flatten(join)
code_block_37 = CodeBlock { 0; 1; 2; 3; 11; 4; 5; 6; 7; 8; 12; 9; 10; 13; 14; }
create_3 = List.Create(code_block_37.out0, code_block_37.out1, code_block_37.out2, code_block_37.out3, code_block_37.out4, code_block_37.out5, code_block_37.out6, code_block_37.out7, code_block_37.out8, code_block_37.out9, code_block_37.out10, code_block_37.out11, code_block_37.out12, code_block_37.out13, code_block_37.out14)
getItemAtIndex = List.GetItemAtIndex(flatten, create_3)
code_block_38 = CodeBlock { 1.2; }
offset_5 = Curve.Offset(byThreePoints, code_block_38)
reverse_2 = Curve.Reverse(offset_5)
code_block_39 = CodeBlock { 21.647698074; 0.750; -21.647698047; }
byCoordinates_34 = Point.ByCoordinates(code_block_39.out0, arg2=code_block_39.out1)
parameterAtPoint_3 = Curve.ParameterAtPoint(reverse_2, byCoordinates_34)
parameterTrimEnd = Curve.ParameterTrimEnd(reverse_2, parameterAtPoint_3)
create_4 = List.Create(byThreePoints_2, byThreePoints_3, byThreePoints_4, byThreePoints_12, byThreePoints_5, byThreePoints_6, byThreePoints_7, byThreePoints_8, byThreePoints_9, byThreePoints_13, byThreePoints_10, byThreePoints_11, byThreePoints_14)
byJoinedCurves = PolyCurve.ByJoinedCurves(create_4)
code_block_40 = CodeBlock { -1.2; }
offset_6 = Curve.Offset(byJoinedCurves, code_block_40)
code_block_41 = CodeBlock { 1.2; }
offset_7 = Curve.Offset(byThreePoints_15, code_block_41)
byCoordinates_35 = Point.ByCoordinates(code_block_39.out2, arg2=code_block_39.out1)
parameterAtPoint_4 = Curve.ParameterAtPoint(offset_7, byCoordinates_35)
parameterTrimEnd_2 = Curve.ParameterTrimEnd(offset_7, parameterAtPoint_4)
create_5 = List.Create(parameterTrimEnd, offset_6, parameterTrimEnd_2)
byJoinedCurves_2 = PolyCurve.ByJoinedCurves(create_5)
startPoint = Curve.StartPoint(byJoinedCurves_2)
code_block_42 = CodeBlock { 20.24; 0; 1.5874; }
byCoordinates_36 = Point.ByCoordinates(code_block_42.out0, code_block_42.out1, code_block_42.out2)
parameterAtPoint_5 = Curve.ParameterAtPoint(byThreePoints, byCoordinates_36)
parameterTrimSegments_3 = Curve.ParameterTrimSegments(byThreePoints, parameterAtPoint_5)
reverse_3 = Curve.Reverse(byThreePoints_15)
reverse_4 = Curve.Reverse(byThreePoints_15)
code_block_43 = CodeBlock { -20.24; 0; 1.5874; }
byCoordinates_37 = Point.ByCoordinates(code_block_43.out0, code_block_43.out1, code_block_43.out2)
parameterAtPoint_6 = Curve.ParameterAtPoint(reverse_4, byCoordinates_37)
parameterTrimSegments_4 = Curve.ParameterTrimSegments(reverse_3, parameterAtPoint_6)
create_6 = List.Create(parameterTrimSegments_3, byThreePoints_2, byThreePoints_3, byThreePoints_4, byThreePoints_5, byThreePoints_6, byThreePoints_7, byThreePoints_8, byThreePoints_9, byThreePoints_10, byThreePoints_11, parameterTrimSegments_4)
flatten_2 = Flatten(create_6)
join_2 = List.Join(flatten_2, create_2)
code_block_44 = CodeBlock { 0; 1; 2; 3; 12; 4; 5; 6; 7; 8; 13; 9; 10; 14; 11; }
create_7 = List.Create(code_block_44.out0, code_block_44.out1, code_block_44.out2, code_block_44.out3, code_block_44.out4, code_block_44.out5, code_block_44.out6, code_block_44.out7, code_block_44.out8, code_block_44.out9, code_block_44.out10, code_block_44.out11, code_block_44.out12, code_block_44.out13, code_block_44.out14)
getItemAtIndex_2 = List.GetItemAtIndex(join_2, create_7)
byJoinedCurves_3 = PolyCurve.ByJoinedCurves(getItemAtIndex_2)
code_block_45 = CodeBlock { 0..#51..0.922198935; }
pointAtDistance = Curve.PointAtDistance(byJoinedCurves_3, code_block_45)
parameterAtPoint_7 = Curve.ParameterAtPoint(byJoinedCurves_3, pointAtDistance)
normalAtParameter = Curve.NormalAtParameter(byJoinedCurves_3, parameterAtPoint_7)
reverse_5 = Vector.Reverse(normalAtParameter)
code_block_46 = CodeBlock { 2; }
byStartPointDirectionLength = Line.ByStartPointDirectionLength(pointAtDistance, reverse_5, code_block_46)
intersect = Geometry.Intersect(byJoinedCurves_2, byStartPointDirectionLength)
flatten_3 = Flatten(intersect)
endPoint = Curve.EndPoint(byJoinedCurves_2)
create_8 = List.Create(startPoint, flatten_3, endPoint)
flatten_4 = Flatten(create_8)
YAxis = Vector.YAxis()
code_block_47 = CodeBlock { -0.5; }
translate = Geometry.Translate(flatten_4, YAxis, code_block_47)
code_block_48 = CodeBlock { -2; }
code_block_49 = CodeBlock { 4; }
takeEveryNthItem = List.TakeEveryNthItem(translate, code_block_48, code_block_49)
YAxis_2 = Vector.YAxis()
code_block_50 = CodeBlock { 0.5; }
translate_2 = Geometry.Translate(flatten_4, YAxis_2, code_block_50)
code_block_51 = CodeBlock { -2; }
code_block_52 = CodeBlock { 4; }
takeEveryNthItem_2 = List.TakeEveryNthItem(translate_2, code_block_51, code_block_52)
translate_3 = Geometry.Translate(byJoinedCurves_2, YAxis_2, code_block_50)
endPoint_2 = Curve.EndPoint(translate_3)
translate_4 = Geometry.Translate(byJoinedCurves_2, YAxis, code_block_47)
endPoint_3 = Curve.EndPoint(translate_4)
code_block_53 = CodeBlock { 2; }
code_block_54 = CodeBlock { 1; }
takeEveryNthItem_3 = List.TakeEveryNthItem(pointAtDistance, code_block_53, code_block_54)
code_block_55 = CodeBlock { 2; }
code_block_56 = CodeBlock { 1; }
takeEveryNthItem_4 = List.TakeEveryNthItem(flatten_4, code_block_55, code_block_56)
translate_5 = Geometry.Translate(takeEveryNthItem_4, YAxis, code_block_47)
code_block_57 = CodeBlock { 1; }
takeItems = List.TakeItems(translate_5, code_block_57)
code_block_58 = CodeBlock { 1; }
takeItems_2 = List.TakeItems(translate_2, code_block_58)
create_9 = List.Create(takeEveryNthItem, takeEveryNthItem_2, endPoint_2, endPoint_3, takeEveryNthItem_3, takeItems, takeItems_2)
flatten_5 = Flatten(create_9)
YAxis_3 = Vector.YAxis()
code_block_59 = CodeBlock { 24; }
translate_6 = Geometry.Translate(flatten_5, YAxis_3, code_block_59)
byPoint = ReferencePoint.ByPoint(translate_6)
YAxis_4 = Vector.YAxis()
code_block_60 = CodeBlock { 16; }
translate_7 = Geometry.Translate(flatten_5, YAxis_4, code_block_60)
byPoint_2 = ReferencePoint.ByPoint(translate_7)
YAxis_5 = Vector.YAxis()
code_block_61 = CodeBlock { 8; }
translate_8 = Geometry.Translate(flatten_5, YAxis_5, code_block_61)
byPoint_3 = ReferencePoint.ByPoint(translate_8)
byPoint_4 = ReferencePoint.ByPoint(flatten_5)
byPoint_5 = ReferencePoint.ByPoint(translate_7)
YAxis_6 = Vector.YAxis()
code_block_62 = CodeBlock { 32; }
translate_9 = Geometry.Translate(flatten_5, YAxis_6, code_block_62)
byPoint_6 = ReferencePoint.ByPoint(translate_9)
parameterAtPoint_8 = Curve.ParameterAtPoint(byJoinedCurves_2, flatten_4)
normalAtParameter_2 = Curve.NormalAtParameter(byJoinedCurves_2, parameterAtPoint_8)
reverse_6 = Vector.Reverse(normalAtParameter_2)
code_block_63 = CodeBlock { 0.27; }
byStartPointDirectionLength_2 = Line.ByStartPointDirectionLength(flatten_4, reverse_6, code_block_63)
endPoint_4 = Curve.EndPoint(byStartPointDirectionLength_2)
YAxis_7 = Vector.YAxis()
code_block_64 = CodeBlock { -0.5; }
translate_10 = Geometry.Translate(endPoint_4, YAxis_7, code_block_64)
code_block_65 = CodeBlock { 4; 5; }
takeEveryNthItem_5 = List.TakeEveryNthItem(translate_10, code_block_65.out0, code_block_65.out1)
code_block_66 = CodeBlock { 33.2; }
translate_11 = Geometry.Translate(takeEveryNthItem_5, YAxis_7, code_block_66)
YAxis_8 = Vector.YAxis()
XAxis = Vector.XAxis()
translate_12 = Geometry.Translate(takeEveryNthItem_4, YAxis_2, code_block_50)
code_block_67 = CodeBlock { 1; }
takeItems_3 = List.TakeItems(translate_12, code_block_67)
code_block_68 = CodeBlock { -1; }
takeItems_4 = List.TakeItems(translate_12, code_block_68)
create_10 = List.Create(takeItems_3, takeItems_4)
flatten_6 = Flatten(create_10)
ZAxis = Vector.ZAxis()
code_block_69 = CodeBlock { -1; }
byStartPointDirectionLength_3 = Line.ByStartPointDirectionLength(flatten_6, ZAxis, code_block_69)
endPoint_5 = Curve.EndPoint(byStartPointDirectionLength_3)
code_block_70 = CodeBlock { 1; -1; }
takeItems_5 = List.TakeItems(endPoint_5, code_block_70.out1)
takeItems_6 = List.TakeItems(endPoint_5, code_block_70.out0)
byStartPointEndPoint = Line.ByStartPointEndPoint(takeItems_5, takeItems_6)
flatten_7 = Flatten(byStartPointEndPoint)
code_block_71 = CodeBlock { 7; }
divideEqually = Curve.DivideEqually(flatten_7, code_block_71)
flatten_8 = Flatten(divideEqually)
pointAtParameter = Curve.PointAtParameter(flatten_8)
flatten_9 = Flatten(pointAtParameter)
code_block_72 = CodeBlock { 1; }
getItemAtIndex_3 = List.GetItemAtIndex(flatten_9, code_block_72)
ZAxis_2 = Vector.ZAxis()
code_block_73 = CodeBlock { 8.6; }
byStartPointDirectionLength_4 = Line.ByStartPointDirectionLength(getItemAtIndex_3, ZAxis_2, code_block_73)
byJoinedCurves_4 = PolyCurve.ByJoinedCurves(translate_3)
curves = PolyCurve.Curves(byJoinedCurves_4)
intersect_2 = Geometry.Intersect(byStartPointDirectionLength_4, curves)
flatten_10 = Flatten(intersect_2)
parameterAtPoint_9 = Curve.ParameterAtPoint(byStartPointDirectionLength_4, flatten_10)
parameterTrimEnd_3 = Curve.ParameterTrimEnd(byStartPointDirectionLength_4, parameterAtPoint_9)
integer_slider = IntegerSlider(14, range=0..26)
divideEqually_2 = Curve.DivideEqually(parameterTrimEnd_3, integer_slider)
flatten_11 = Flatten(divideEqually_2)
endPoint_6 = Curve.EndPoint(flatten_11)
code_block_74 = CodeBlock { -1; 1; }
takeItems_7 = List.TakeItems(endPoint_6, code_block_74.out0)
pointAtParameter_2 = Curve.PointAtParameter(flatten_11)
flatten_12 = Flatten(pointAtParameter_2)
code_block_75 = CodeBlock { 1; }
dropItems = List.DropItems(flatten_12, code_block_75)
YAxis_9 = Vector.YAxis()
double_slider = DoubleSlider(0.45, range=0..0.6)
translate_13 = Geometry.Translate(dropItems, YAxis_9, double_slider)
code_block_76 = CodeBlock { 2; 1; }
takeEveryNthItem_6 = List.TakeEveryNthItem(translate_13, code_block_76.out0, code_block_76.out1)
code_block_77 = CodeBlock { -1; }
takeItems_8 = List.TakeItems(takeEveryNthItem_6, code_block_77)
byStartPointEndPoint_2 = Line.ByStartPointEndPoint(takeItems_7, takeItems_8)
code_block_78 = CodeBlock { 1; }
takeItems_9 = List.TakeItems(takeEveryNthItem_6, code_block_78)
byStartPointEndPoint_3 = Line.ByStartPointEndPoint(takeItems_8, takeItems_9)
startPoint_2 = Curve.StartPoint(flatten_11)
takeItems_10 = List.TakeItems(startPoint_2, code_block_74.out1)
byStartPointEndPoint_4 = Line.ByStartPointEndPoint(takeItems_9, takeItems_10)
code_block_79 = CodeBlock { 2; }
getItemAtIndex_4 = List.GetItemAtIndex(flatten_9, code_block_79)
ZAxis_3 = Vector.ZAxis()
code_block_80 = CodeBlock { 12; }
byStartPointDirectionLength_5 = Line.ByStartPointDirectionLength(getItemAtIndex_4, ZAxis_3, code_block_80)
intersect_3 = Geometry.Intersect(byStartPointDirectionLength_5, curves)
flatten_13 = Flatten(intersect_3)
parameterAtPoint_10 = Curve.ParameterAtPoint(byStartPointDirectionLength_5, flatten_13)
parameterTrimEnd_4 = Curve.ParameterTrimEnd(byStartPointDirectionLength_5, parameterAtPoint_10)
integer_slider_2 = IntegerSlider(18, range=0..26)
divideEqually_3 = Curve.DivideEqually(parameterTrimEnd_4, integer_slider_2)
flatten_14 = Flatten(divideEqually_3)
endPoint_7 = Curve.EndPoint(flatten_14)
code_block_81 = CodeBlock { -1; 1; }
takeItems_11 = List.TakeItems(endPoint_7, code_block_81.out0)
pointAtParameter_3 = Curve.PointAtParameter(flatten_14)
flatten_15 = Flatten(pointAtParameter_3)
code_block_82 = CodeBlock { 1; }
dropItems_2 = List.DropItems(flatten_15, code_block_82)
YAxis_10 = Vector.YAxis()
double_slider_2 = DoubleSlider(0.45, range=0..0.6)
translate_14 = Geometry.Translate(dropItems_2, YAxis_10, double_slider_2)
code_block_83 = CodeBlock { 2; 1; }
takeEveryNthItem_7 = List.TakeEveryNthItem(translate_14, code_block_83.out0, code_block_83.out1)
code_block_84 = CodeBlock { -1; }
takeItems_12 = List.TakeItems(takeEveryNthItem_7, code_block_84)
byStartPointEndPoint_5 = Line.ByStartPointEndPoint(takeItems_11, takeItems_12)
code_block_85 = CodeBlock { 1; }
takeItems_13 = List.TakeItems(takeEveryNthItem_7, code_block_85)
byStartPointEndPoint_6 = Line.ByStartPointEndPoint(takeItems_12, takeItems_13)
startPoint_3 = Curve.StartPoint(flatten_14)
takeItems_14 = List.TakeItems(startPoint_3, code_block_81.out1)
byStartPointEndPoint_7 = Line.ByStartPointEndPoint(takeItems_13, takeItems_14)
code_block_86 = CodeBlock { 3; }
getItemAtIndex_5 = List.GetItemAtIndex(flatten_9, code_block_86)
ZAxis_4 = Vector.ZAxis()
code_block_87 = CodeBlock { 14; }
byStartPointDirectionLength_6 = Line.ByStartPointDirectionLength(getItemAtIndex_5, ZAxis_4, code_block_87)
intersect_4 = Geometry.Intersect(byStartPointDirectionLength_6, curves)
flatten_16 = Flatten(intersect_4)
parameterAtPoint_11 = Curve.ParameterAtPoint(byStartPointDirectionLength_6, flatten_16)
parameterTrimEnd_5 = Curve.ParameterTrimEnd(byStartPointDirectionLength_6, parameterAtPoint_11)
integer_slider_3 = IntegerSlider(26, range=0..26)
divideEqually_4 = Curve.DivideEqually(parameterTrimEnd_5, integer_slider_3)
flatten_17 = Flatten(divideEqually_4)
endPoint_8 = Curve.EndPoint(flatten_17)
code_block_88 = CodeBlock { -1; 1; }
takeItems_15 = List.TakeItems(endPoint_8, code_block_88.out0)
pointAtParameter_4 = Curve.PointAtParameter(flatten_17)
flatten_18 = Flatten(pointAtParameter_4)
code_block_89 = CodeBlock { 1; }
dropItems_3 = List.DropItems(flatten_18, code_block_89)
YAxis_11 = Vector.YAxis()
double_slider_3 = DoubleSlider(0.45, range=0..0.6)
translate_15 = Geometry.Translate(dropItems_3, YAxis_11, double_slider_3)
code_block_90 = CodeBlock { 2; 1; }
takeEveryNthItem_8 = List.TakeEveryNthItem(translate_15, code_block_90.out0, code_block_90.out1)
code_block_91 = CodeBlock { -1; }
takeItems_16 = List.TakeItems(takeEveryNthItem_8, code_block_91)
byStartPointEndPoint_8 = Line.ByStartPointEndPoint(takeItems_15, takeItems_16)
code_block_92 = CodeBlock { 1; }
takeItems_17 = List.TakeItems(takeEveryNthItem_8, code_block_92)
byStartPointEndPoint_9 = Line.ByStartPointEndPoint(takeItems_16, takeItems_17)
startPoint_4 = Curve.StartPoint(flatten_17)
takeItems_18 = List.TakeItems(startPoint_4, code_block_88.out1)
byStartPointEndPoint_10 = Line.ByStartPointEndPoint(takeItems_17, takeItems_18)
code_block_93 = CodeBlock { 4; }
getItemAtIndex_6 = List.GetItemAtIndex(flatten_9, code_block_93)
ZAxis_5 = Vector.ZAxis()
code_block_94 = CodeBlock { 14; }
byStartPointDirectionLength_7 = Line.ByStartPointDirectionLength(getItemAtIndex_6, ZAxis_5, code_block_94)
intersect_5 = Geometry.Intersect(byStartPointDirectionLength_7, curves)
flatten_19 = Flatten(intersect_5)
parameterAtPoint_12 = Curve.ParameterAtPoint(byStartPointDirectionLength_7, flatten_19)
parameterTrimEnd_6 = Curve.ParameterTrimEnd(byStartPointDirectionLength_7, parameterAtPoint_12)
integer_slider_4 = IntegerSlider(26, range=0..26)
divideEqually_5 = Curve.DivideEqually(parameterTrimEnd_6, integer_slider_4)
flatten_20 = Flatten(divideEqually_5)
endPoint_9 = Curve.EndPoint(flatten_20)
code_block_95 = CodeBlock { -1; 1; }
takeItems_19 = List.TakeItems(endPoint_9, code_block_95.out0)
pointAtParameter_5 = Curve.PointAtParameter(flatten_20)
flatten_21 = Flatten(pointAtParameter_5)
code_block_96 = CodeBlock { 1; }
dropItems_4 = List.DropItems(flatten_21, code_block_96)
YAxis_12 = Vector.YAxis()
double_slider_4 = DoubleSlider(0.45, range=0..0.6)
translate_16 = Geometry.Translate(dropItems_4, YAxis_12, double_slider_4)
code_block_97 = CodeBlock { 2; 1; }
takeEveryNthItem_9 = List.TakeEveryNthItem(translate_16, code_block_97.out0, code_block_97.out1)
code_block_98 = CodeBlock { -1; }
takeItems_20 = List.TakeItems(takeEveryNthItem_9, code_block_98)
byStartPointEndPoint_11 = Line.ByStartPointEndPoint(takeItems_19, takeItems_20)
code_block_99 = CodeBlock { 1; }
takeItems_21 = List.TakeItems(takeEveryNthItem_9, code_block_99)
byStartPointEndPoint_12 = Line.ByStartPointEndPoint(takeItems_20, takeItems_21)
startPoint_5 = Curve.StartPoint(flatten_20)
takeItems_22 = List.TakeItems(startPoint_5, code_block_95.out1)
byStartPointEndPoint_13 = Line.ByStartPointEndPoint(takeItems_21, takeItems_22)
code_block_100 = CodeBlock { 5; }
getItemAtIndex_7 = List.GetItemAtIndex(flatten_9, code_block_100)
ZAxis_6 = Vector.ZAxis()
code_block_101 = CodeBlock { 14; }
byStartPointDirectionLength_8 = Line.ByStartPointDirectionLength(getItemAtIndex_7, ZAxis_6, code_block_101)
intersect_6 = Geometry.Intersect(byStartPointDirectionLength_8, curves)
flatten_22 = Flatten(intersect_6)
parameterAtPoint_13 = Curve.ParameterAtPoint(byStartPointDirectionLength_8, flatten_22)
parameterTrimEnd_7 = Curve.ParameterTrimEnd(byStartPointDirectionLength_8, parameterAtPoint_13)
integer_slider_5 = IntegerSlider(22, range=0..26)
divideEqually_6 = Curve.DivideEqually(parameterTrimEnd_7, integer_slider_5)
flatten_23 = Flatten(divideEqually_6)
endPoint_10 = Curve.EndPoint(flatten_23)
code_block_102 = CodeBlock { -1; 1; }
takeItems_23 = List.TakeItems(endPoint_10, code_block_102.out0)
pointAtParameter_6 = Curve.PointAtParameter(flatten_23)
flatten_24 = Flatten(pointAtParameter_6)
code_block_103 = CodeBlock { 1; }
dropItems_5 = List.DropItems(flatten_24, code_block_103)
YAxis_13 = Vector.YAxis()
double_slider_5 = DoubleSlider(0.45, range=0..0.6)
translate_17 = Geometry.Translate(dropItems_5, YAxis_13, double_slider_5)
code_block_104 = CodeBlock { 2; 1; }
takeEveryNthItem_10 = List.TakeEveryNthItem(translate_17, code_block_104.out0, code_block_104.out1)
code_block_105 = CodeBlock { -1; }
takeItems_24 = List.TakeItems(takeEveryNthItem_10, code_block_105)
byStartPointEndPoint_14 = Line.ByStartPointEndPoint(takeItems_23, takeItems_24)
code_block_106 = CodeBlock { 1; }
takeItems_25 = List.TakeItems(takeEveryNthItem_10, code_block_106)
byStartPointEndPoint_15 = Line.ByStartPointEndPoint(takeItems_24, takeItems_25)
startPoint_6 = Curve.StartPoint(flatten_23)
takeItems_26 = List.TakeItems(startPoint_6, code_block_102.out1)
byStartPointEndPoint_16 = Line.ByStartPointEndPoint(takeItems_25, takeItems_26)
code_block_107 = CodeBlock { 6; }
getItemAtIndex_8 = List.GetItemAtIndex(flatten_9, code_block_107)
ZAxis_7 = Vector.ZAxis()
code_block_108 = CodeBlock { 14; }
byStartPointDirectionLength_9 = Line.ByStartPointDirectionLength(getItemAtIndex_8, ZAxis_7, code_block_108)
intersect_7 = Geometry.Intersect(byStartPointDirectionLength_9, curves)
flatten_25 = Flatten(intersect_7)
parameterAtPoint_14 = Curve.ParameterAtPoint(byStartPointDirectionLength_9, flatten_25)
parameterTrimEnd_8 = Curve.ParameterTrimEnd(byStartPointDirectionLength_9, parameterAtPoint_14)
integer_slider_6 = IntegerSlider(18, range=0..26)
divideEqually_7 = Curve.DivideEqually(parameterTrimEnd_8, integer_slider_6)
flatten_26 = Flatten(divideEqually_7)
endPoint_11 = Curve.EndPoint(flatten_26)
code_block_109 = CodeBlock { -1; 1; }
takeItems_27 = List.TakeItems(endPoint_11, code_block_109.out0)
pointAtParameter_7 = Curve.PointAtParameter(flatten_26)
flatten_27 = Flatten(pointAtParameter_7)
code_block_110 = CodeBlock { 1; }
dropItems_6 = List.DropItems(flatten_27, code_block_110)
YAxis_14 = Vector.YAxis()
double_slider_6 = DoubleSlider(0.45, range=0..0.6)
translate_18 = Geometry.Translate(dropItems_6, YAxis_14, double_slider_6)
code_block_111 = CodeBlock { 2; 1; }
takeEveryNthItem_11 = List.TakeEveryNthItem(translate_18, code_block_111.out0, code_block_111.out1)
code_block_112 = CodeBlock { -1; }
takeItems_28 = List.TakeItems(takeEveryNthItem_11, code_block_112)
byStartPointEndPoint_17 = Line.ByStartPointEndPoint(takeItems_27, takeItems_28)
code_block_113 = CodeBlock { 1; }
takeItems_29 = List.TakeItems(takeEveryNthItem_11, code_block_113)
byStartPointEndPoint_18 = Line.ByStartPointEndPoint(takeItems_28, takeItems_29)
startPoint_7 = Curve.StartPoint(flatten_26)
takeItems_30 = List.TakeItems(startPoint_7, code_block_109.out1)
byStartPointEndPoint_19 = Line.ByStartPointEndPoint(takeItems_29, takeItems_30)
create_11 = List.Create(parameterTrimEnd_3, byStartPointEndPoint_2, byStartPointEndPoint_3, byStartPointEndPoint_4, parameterTrimEnd_4, byStartPointEndPoint_5, byStartPointEndPoint_6, byStartPointEndPoint_7, parameterTrimEnd_5, byStartPointEndPoint_8, byStartPointEndPoint_9, byStartPointEndPoint_10, parameterTrimEnd_6, byStartPointEndPoint_11, byStartPointEndPoint_12, byStartPointEndPoint_13, parameterTrimEnd_7, byStartPointEndPoint_14, byStartPointEndPoint_15, byStartPointEndPoint_16, parameterTrimEnd_8, byStartPointEndPoint_17, byStartPointEndPoint_18, byStartPointEndPoint_19)
code_block_114 = CodeBlock { 2; 2; }
takeEveryNthItem_12 = List.TakeEveryNthItem(dropItems, code_block_114.out0, code_block_114.out1)
code_block_115 = CodeBlock { 1; }
dropItems_7 = List.DropItems(takeEveryNthItem_6, code_block_115)
byStartPointEndPoint_20 = Line.ByStartPointEndPoint(takeEveryNthItem_12, dropItems_7)
code_block_116 = CodeBlock { -1; }
dropItems_8 = List.DropItems(takeEveryNthItem_6, code_block_116)
byStartPointEndPoint_21 = Line.ByStartPointEndPoint(takeEveryNthItem_12, dropItems_8)
code_block_117 = CodeBlock { 2; 2; }
takeEveryNthItem_13 = List.TakeEveryNthItem(dropItems_2, code_block_117.out0, code_block_117.out1)
code_block_118 = CodeBlock { 1; }
dropItems_9 = List.DropItems(takeEveryNthItem_7, code_block_118)
byStartPointEndPoint_22 = Line.ByStartPointEndPoint(takeEveryNthItem_13, dropItems_9)
code_block_119 = CodeBlock { -1; }
dropItems_10 = List.DropItems(takeEveryNthItem_7, code_block_119)
byStartPointEndPoint_23 = Line.ByStartPointEndPoint(takeEveryNthItem_13, dropItems_10)
code_block_120 = CodeBlock { 2; 2; }
takeEveryNthItem_14 = List.TakeEveryNthItem(dropItems_3, code_block_120.out0, code_block_120.out1)
code_block_121 = CodeBlock { 1; }
dropItems_11 = List.DropItems(takeEveryNthItem_8, code_block_121)
byStartPointEndPoint_24 = Line.ByStartPointEndPoint(takeEveryNthItem_14, dropItems_11)
code_block_122 = CodeBlock { -1; }
dropItems_12 = List.DropItems(takeEveryNthItem_8, code_block_122)
byStartPointEndPoint_25 = Line.ByStartPointEndPoint(takeEveryNthItem_14, dropItems_12)
code_block_123 = CodeBlock { 2; 2; }
takeEveryNthItem_15 = List.TakeEveryNthItem(dropItems_4, code_block_123.out0, code_block_123.out1)
code_block_124 = CodeBlock { 1; }
dropItems_13 = List.DropItems(takeEveryNthItem_9, code_block_124)
byStartPointEndPoint_26 = Line.ByStartPointEndPoint(takeEveryNthItem_15, dropItems_13)
code_block_125 = CodeBlock { -1; }
dropItems_14 = List.DropItems(takeEveryNthItem_9, code_block_125)
byStartPointEndPoint_27 = Line.ByStartPointEndPoint(takeEveryNthItem_15, dropItems_14)
code_block_126 = CodeBlock { 2; 2; }
takeEveryNthItem_16 = List.TakeEveryNthItem(dropItems_5, code_block_126.out0, code_block_126.out1)
code_block_127 = CodeBlock { 1; }
dropItems_15 = List.DropItems(takeEveryNthItem_10, code_block_127)
byStartPointEndPoint_28 = Line.ByStartPointEndPoint(takeEveryNthItem_16, dropItems_15)
code_block_128 = CodeBlock { -1; }
dropItems_16 = List.DropItems(takeEveryNthItem_10, code_block_128)
byStartPointEndPoint_29 = Line.ByStartPointEndPoint(takeEveryNthItem_16, dropItems_16)
code_block_129 = CodeBlock { 2; 2; }
takeEveryNthItem_17 = List.TakeEveryNthItem(dropItems_6, code_block_129.out0, code_block_129.out1)
code_block_130 = CodeBlock { 1; }
dropItems_17 = List.DropItems(takeEveryNthItem_11, code_block_130)
byStartPointEndPoint_30 = Line.ByStartPointEndPoint(takeEveryNthItem_17, dropItems_17)
code_block_131 = CodeBlock { -1; }
dropItems_18 = List.DropItems(takeEveryNthItem_11, code_block_131)
byStartPointEndPoint_31 = Line.ByStartPointEndPoint(takeEveryNthItem_17, dropItems_18)
create_12 = List.Create(byStartPointEndPoint_20, byStartPointEndPoint_21, byStartPointEndPoint_22, byStartPointEndPoint_23, byStartPointEndPoint_24, byStartPointEndPoint_25, byStartPointEndPoint_26, byStartPointEndPoint_27, byStartPointEndPoint_28, byStartPointEndPoint_29, byStartPointEndPoint_30, byStartPointEndPoint_31)
takeEveryNthItem_18 = List.TakeEveryNthItem(byStartPointDirectionLength_2, code_block_65.out0, code_block_65.out1)
code_block_132 = CodeBlock { -0.5; 0.5; }
translate_19 = Geometry.Translate(takeEveryNthItem_18, YAxis_7, code_block_132.out0)
translate_20 = Geometry.Translate(takeEveryNthItem_18, YAxis_7, code_block_132.out1)
create_13 = List.Create(translate_19, translate_20)
flatten_28 = Flatten(create_13)
code_block_133 = CodeBlock { 8; 16; 24; 32; }
translate_21 = Geometry.Translate(flatten_28, YAxis_7, code_block_133.out0)
translate_22 = Geometry.Translate(flatten_28, YAxis_7, code_block_133.out1)
translate_23 = Geometry.Translate(flatten_28, YAxis_7, code_block_133.out2)
translate_24 = Geometry.Translate(flatten_28, YAxis_7, code_block_133.out3)
create_14 = List.Create(flatten_28, translate_21, translate_22, translate_23, translate_24)
takeEveryNthItem_19 = List.TakeEveryNthItem(flatten_4, code_block_65.out0, code_block_65.out1)
code_block_134 = CodeBlock { 16.5; 23.5; }
translate_25 = Geometry.Translate(takeEveryNthItem_19, YAxis_7, code_block_134.out0)
translate_26 = Geometry.Translate(takeEveryNthItem_19, YAxis_7, code_block_134.out1)
code_block_135 = CodeBlock { 1; }
dropItems_19 = List.DropItems(translate_26, code_block_135)
byStartPointEndPoint_32 = Line.ByStartPointEndPoint(translate_25, dropItems_19)
code_block_136 = CodeBlock { 1; }
dropItems_20 = List.DropItems(translate_25, code_block_136)
byStartPointEndPoint_33 = Line.ByStartPointEndPoint(translate_26, dropItems_20)
create_15 = List.Create(byStartPointEndPoint_32, byStartPointEndPoint_33)
YAxis_15 = Vector.YAxis()
code_block_137 = CodeBlock { -8; }
translate_27 = Geometry.Translate(create_15, YAxis_15, code_block_137)
create_16 = List.Create(translate_27, create_15)
flatten_29 = Flatten(create_16)
levels = Levels("SPORT FACILITY 10")
ZAxis_8 = Vector.ZAxis()
beam = StructuralType.Beam()
structural_framing_types = StructuralFramingTypes("24mm DIAMETER ROD")
byCurveLevelUpVectorAndType = StructuralFraming.ByCurveLevelUpVectorAndType(flatten_29, levels, ZAxis_8, beam, structural_framing_types)
code_block_138 = CodeBlock { 51; }
dropItems_21 = List.DropItems(translate_2, code_block_138)
code_block_139 = CodeBlock { 51; }
dropItems_22 = List.DropItems(translate, code_block_139)
byStartPointEndPoint_34 = Line.ByStartPointEndPoint(dropItems_21, dropItems_22)
code_block_140 = CodeBlock { 1; -1; }
dropItems_23 = List.DropItems(byStartPointEndPoint_34, code_block_140.out1)
code_block_141 = CodeBlock { -1; }
dropItems_24 = List.DropItems(dropItems_22, code_block_141)
endPoint_12 = Curve.EndPoint(byJoinedCurves_3)
byStartPointEndPoint_35 = Line.ByStartPointEndPoint(dropItems_24, endPoint_12)
code_block_142 = CodeBlock { 1; }
takeItems_31 = List.TakeItems(dropItems_21, code_block_142)
byStartPointEndPoint_36 = Line.ByStartPointEndPoint(endPoint_12, takeItems_31)
code_block_143 = CodeBlock { -51; }
dropItems_25 = List.DropItems(translate_2, code_block_143)
code_block_144 = CodeBlock { -51; }
dropItems_26 = List.DropItems(translate, code_block_144)
byStartPointEndPoint_37 = Line.ByStartPointEndPoint(dropItems_25, dropItems_26)
code_block_145 = CodeBlock { -1; 1; }
dropItems_27 = List.DropItems(byStartPointEndPoint_37, code_block_145.out1)
code_block_146 = CodeBlock { 2; }
code_block_147 = CodeBlock { 3; }
takeEveryNthItem_20 = List.TakeEveryNthItem(translate, code_block_146, code_block_147)
code_block_148 = CodeBlock { 1; }
dropItems_28 = List.DropItems(takeEveryNthItem_20, code_block_148)
byStartPointEndPoint_38 = Line.ByStartPointEndPoint(takeEveryNthItem_2, dropItems_28)
byStartPointEndPoint_39 = Line.ByStartPointEndPoint(takeEveryNthItem_2, takeEveryNthItem_20)
byStartPointEndPoint_40 = Line.ByStartPointEndPoint(takeEveryNthItem_3, translate_12)
code_block_149 = CodeBlock { 1; }
dropItems_29 = List.DropItems(byStartPointEndPoint_40, code_block_149)
byStartPointEndPoint_41 = Line.ByStartPointEndPoint(takeEveryNthItem_3, translate_5)
code_block_150 = CodeBlock { 1; }
dropItems_30 = List.DropItems(byStartPointEndPoint_41, code_block_150)
code_block_151 = CodeBlock { 2; }
code_block_152 = CodeBlock { 2; }
takeEveryNthItem_21 = List.TakeEveryNthItem(flatten_3, code_block_151, code_block_152)
translate_28 = Geometry.Translate(takeEveryNthItem_21, YAxis_2, code_block_50)
byStartPointEndPoint_42 = Line.ByStartPointEndPoint(takeEveryNthItem_3, translate_28)
translate_29 = Geometry.Translate(takeEveryNthItem_21, YAxis, code_block_47)
byStartPointEndPoint_43 = Line.ByStartPointEndPoint(takeEveryNthItem_3, translate_29)
code_block_153 = CodeBlock { -1; }
takeItems_32 = List.TakeItems(dropItems_25, code_block_153)
startPoint_8 = Curve.StartPoint(byJoinedCurves_3)
byStartPointEndPoint_44 = Line.ByStartPointEndPoint(takeItems_32, startPoint_8)
code_block_154 = CodeBlock { -1; }
takeItems_33 = List.TakeItems(dropItems_26, code_block_154)
byStartPointEndPoint_45 = Line.ByStartPointEndPoint(takeItems_33, startPoint_8)
create_17 = List.Create(dropItems_23, byStartPointEndPoint_35, byStartPointEndPoint_36, dropItems_27, byStartPointEndPoint_38, byStartPointEndPoint_39, dropItems_29, dropItems_30, byStartPointEndPoint_42, byStartPointEndPoint_43, byStartPointEndPoint_44, byStartPointEndPoint_45)
flatten_30 = Flatten(create_17)
YAxis_16 = Vector.YAxis()
code_block_155 = CodeBlock { 8; }
translate_30 = Geometry.Translate(flatten_30, YAxis_16, code_block_155)
YAxis_17 = Vector.YAxis()
code_block_156 = CodeBlock { 16; }
translate_31 = Geometry.Translate(flatten_30, YAxis_17, code_block_156)
YAxis_18 = Vector.YAxis()
code_block_157 = CodeBlock { 24; }
translate_32 = Geometry.Translate(flatten_30, YAxis_18, code_block_157)
YAxis_19 = Vector.YAxis()
code_block_158 = CodeBlock { 32; }
translate_33 = Geometry.Translate(flatten_30, YAxis_19, code_block_158)
create_18 = List.Create(flatten_30, translate_30, translate_31, translate_32, translate_33)
flatten_31 = Flatten(create_18)
levels_2 = Levels("SPORT FACILITY 10")
ZAxis_9 = Vector.ZAxis()
beam_2 = StructuralType.Beam()
structural_framing_types_2 = StructuralFramingTypes("CHS88.9x6")
byCurveLevelUpVectorAndType_2 = StructuralFraming.ByCurveLevelUpVectorAndType(flatten_31, levels_2, ZAxis_9, beam_2, structural_framing_types_2)
byJoinedCurves_5 = PolyCurve.ByJoinedCurves(translate_4)
curves_2 = PolyCurve.Curves(byJoinedCurves_5)
curves_3 = PolyCurve.Curves(byJoinedCurves_3)
create_19 = List.Create(curves, curves_2, curves_3)
flatten_32 = Flatten(create_19)
YAxis_20 = Vector.YAxis()
code_block_159 = CodeBlock { 8; }
translate_34 = Geometry.Translate(flatten_32, YAxis_20, code_block_159)
YAxis_21 = Vector.YAxis()
code_block_160 = CodeBlock { 16; }
translate_35 = Geometry.Translate(flatten_32, YAxis_21, code_block_160)
YAxis_22 = Vector.YAxis()
code_block_161 = CodeBlock { 24; }
translate_36 = Geometry.Translate(flatten_32, YAxis_22, code_block_161)
dropItems_31 = List.DropItems(byStartPointEndPoint_34, code_block_140.out0)
byStartPointEndPoint_46 = Line.ByStartPointEndPoint(endPoint_2, endPoint_12)
byStartPointEndPoint_47 = Line.ByStartPointEndPoint(endPoint_12, endPoint_3)
dropItems_32 = List.DropItems(byStartPointEndPoint_37, code_block_145.out0)
startPoint_9 = Curve.StartPoint(byJoinedCurves_3)
byStartPointEndPoint_48 = Line.ByStartPointEndPoint(takeItems_2, startPoint_9)
byStartPointEndPoint_49 = Line.ByStartPointEndPoint(takeItems, startPoint_9)
create_20 = List.Create(dropItems_31, byStartPointEndPoint_46, byStartPointEndPoint_47, dropItems_32, byStartPointEndPoint_48, byStartPointEndPoint_49)
flatten_33 = Flatten(create_20)
YAxis_23 = Vector.YAxis()
code_block_162 = CodeBlock { 8; }
translate_37 = Geometry.Translate(flatten_33, YAxis_23, code_block_162)
YAxis_24 = Vector.YAxis()
code_block_163 = CodeBlock { 16; }
translate_38 = Geometry.Translate(flatten_33, YAxis_24, code_block_163)
YAxis_25 = Vector.YAxis()
code_block_164 = CodeBlock { 24; }
translate_39 = Geometry.Translate(flatten_33, YAxis_25, code_block_164)
YAxis_26 = Vector.YAxis()
code_block_165 = CodeBlock { 32; }
translate_40 = Geometry.Translate(flatten_32, YAxis_26, code_block_165)
YAxis_27 = Vector.YAxis()
code_block_166 = CodeBlock { 32; }
translate_41 = Geometry.Translate(flatten_33, YAxis_27, code_block_166)
create_21 = List.Create(flatten_32, translate_34, translate_35, translate_36, flatten_33, translate_37, translate_38, translate_39, translate_40, translate_41)
flatten_34 = Flatten(create_21)
levels_3 = Levels("SPORT FACILITY 10")
ZAxis_10 = Vector.ZAxis()
beam_3 = StructuralType.Beam()
structural_framing_types_3 = StructuralFramingTypes("CHS219.1x10")
byCurveLevelUpVectorAndType_3 = StructuralFraming.ByCurveLevelUpVectorAndType(flatten_34, levels_3, ZAxis_10, beam_3, structural_framing_types_3)
