# Dynamo graph Project Mint - Zone A Services.dyn (Dynamo 0.7.5.3881)

double_slider = DoubleSlider(10, range=0..100)
byCoordinates = Point.ByCoordinates(arg2=double_slider)
double_slider_2 = DoubleSlider(22, range=0..100)
byCoordinates_2 = Point.ByCoordinates(double_slider_2, arg2=double_slider)
byStartPointEndPoint = Line.ByStartPointEndPoint(byCoordinates, byCoordinates_2)
byCoordinates_3 = Point.ByCoordinates()
byCoordinates_4 = Point.ByCoordinates(double_slider_2)
byStartPointEndPoint_2 = Line.ByStartPointEndPoint(byCoordinates_3, byCoordinates_4)
double_slider_3 = DoubleSlider(4, range=0..100)
byCoordinates_5 = Point.ByCoordinates(arg1=double_slider_3, arg2=double_slider)
byCoordinates_6 = Point.ByCoordinates(double_slider_2, double_slider_3, double_slider)
byStartPointEndPoint_3 = Line.ByStartPointEndPoint(byCoordinates_5, byCoordinates_6)
byCoordinates_7 = Point.ByCoordinates(arg1=double_slider_3)
byCoordinates_8 = Point.ByCoordinates(double_slider_2, double_slider_3)
byStartPointEndPoint_4 = Line.ByStartPointEndPoint(byCoordinates_7, byCoordinates_8)
create = List.Create(byStartPointEndPoint, byStartPointEndPoint_2, byStartPointEndPoint_3, byStartPointEndPoint_4)
flatten = Flatten(create)
levels = Levels("LEVEL 1")
structural_framing_types = StructuralFramingTypes("UB305x127x37")
beamByCurve = StructuralFraming.BeamByCurve(flatten, levels, structural_framing_types)
double_slider_4 = DoubleSlider(2.2, range=0..100)
divideByLengthFromParameter = Curve.DivideByLengthFromParameter(byStartPointEndPoint, double_slider_4, double_slider_2)
pointAtParameter = Curve.PointAtParameter(divideByLengthFromParameter)
create_2 = List.Create(pointAtParameter, byCoordinates_2)
flatten_2 = Flatten(create_2)
code_block = CodeBlock { 1; -1; }
dropItems = List.DropItems(flatten_2, code_block.out0)
divideByLengthFromParameter_2 = Curve.DivideByLengthFromParameter(byStartPointEndPoint_2, double_slider_4, double_slider_2)
pointAtParameter_2 = Curve.PointAtParameter(divideByLengthFromParameter_2)
create_3 = List.Create(pointAtParameter_2, byCoordinates_4)
flatten_3 = Flatten(create_3)
dropItems_2 = List.DropItems(flatten_3, code_block.out1)
byStartPointEndPoint_5 = Line.ByStartPointEndPoint(dropItems, dropItems_2)
dropItems_3 = List.DropItems(flatten_2, code_block.out1)
dropItems_4 = List.DropItems(flatten_3, code_block.out0)
byStartPointEndPoint_6 = Line.ByStartPointEndPoint(dropItems_3, dropItems_4)
divideByLengthFromParameter_3 = Curve.DivideByLengthFromParameter(byStartPointEndPoint_3, double_slider_4, double_slider_2)
pointAtParameter_3 = Curve.PointAtParameter(divideByLengthFromParameter_3)
create_4 = List.Create(pointAtParameter_3, byCoordinates_6)
flatten_4 = Flatten(create_4)
dropItems_5 = List.DropItems(flatten_4, code_block.out0)
divideByLengthFromParameter_4 = Curve.DivideByLengthFromParameter(byStartPointEndPoint_4, double_slider_4, double_slider_2)
pointAtParameter_4 = Curve.PointAtParameter(divideByLengthFromParameter_4)
create_5 = List.Create(pointAtParameter_4, byCoordinates_8)
flatten_5 = Flatten(create_5)
dropItems_6 = List.DropItems(flatten_5, code_block.out1)
byStartPointEndPoint_7 = Line.ByStartPointEndPoint(dropItems_5, dropItems_6)
dropItems_7 = List.DropItems(flatten_4, code_block.out1)
dropItems_8 = List.DropItems(flatten_5, code_block.out0)
byStartPointEndPoint_8 = Line.ByStartPointEndPoint(dropItems_7, dropItems_8)
dropItems_9 = List.DropItems(flatten_5, code_block.out0)
byStartPointEndPoint_9 = Line.ByStartPointEndPoint(flatten_3, dropItems_9)
dropItems_10 = List.DropItems(flatten_3, code_block.out0)
byStartPointEndPoint_10 = Line.ByStartPointEndPoint(dropItems_6, dropItems_10)
dropItems_11 = List.DropItems(flatten_2, code_block.out0)
byStartPointEndPoint_11 = Line.ByStartPointEndPoint(dropItems_11, flatten_4)
dropItems_12 = List.DropItems(flatten_4, code_block.out0)
byStartPointEndPoint_12 = Line.ByStartPointEndPoint(dropItems_12, pointAtParameter)
create_6 = List.Create(byStartPointEndPoint_5, byStartPointEndPoint_6, byStartPointEndPoint_7, byStartPointEndPoint_8, byStartPointEndPoint_9, byStartPointEndPoint_10, byStartPointEndPoint_11, byStartPointEndPoint_12)
flatten_6 = Flatten(create_6)
levels_2 = Levels("LEVEL 1")
structural_framing_types_2 = StructuralFramingTypes("CHS139.7x3.2")
braceByCurve = StructuralFraming.BraceByCurve(flatten_6, levels_2, structural_framing_types_2)
byStartPointEndPoint_13 = Line.ByStartPointEndPoint(flatten_2, flatten_3)
byStartPointEndPoint_14 = Line.ByStartPointEndPoint(flatten_4, flatten_5)
create_7 = List.Create(byStartPointEndPoint_13, byStartPointEndPoint_14)
flatten_7 = Flatten(create_7)
levels_3 = Levels("LEVEL 1")
structural_framing_types_3 = StructuralFramingTypes("SHS200x200x10")
braceByCurve_2 = StructuralFraming.BraceByCurve(flatten_7, levels_3, structural_framing_types_3)
