# Dynamo graph Arch-Struct Coordination.dyn (Dynamo 0.8.0.950)

location = Custom[Element.Location]()  # Returns the location of an element as an XYZ (or if it's line-based the start and end point of the line), along with some booleans to help filtering the results. Use this for some element types (e.g. walls or lines) that do not work with the built-in Get Family Instance Location node.
X = Point.X(location.Points)
Y = Point.Y(location.Points)
Z = Point.Z(location.Points)
categories = Categories("Columns")
all_elements_of_category = ElementsOfCategory(categories)
watch = Watch(all_elements_of_category)
curves = Element.Curves(all_elements_of_category)
