# Dynamo graph Place Family at Grid Intersection.dyn (Dynamo 0.8.2.2392)

code_block = CodeBlock { "350Ø R.C. PILE"; "_BH_R.C. Pile"; }
byFamilyNameAndTypeName = FamilySymbol.ByFamilyNameAndTypeName(code_block.out1, code_block.out0)
categories = Categories("Grids")
all_elements_of_category = ElementsOfCategory(categories)
create = List.Create(all_elements_of_category)
flatten = Flatten(create)
code_block_2 = CodeBlock { 10; }
takeItems = List.TakeItems(list=flatten, amount=code_block_2)
curve = Grid.Curve(takeItems)
dropItems = List.DropItems(list=flatten, amount=code_block_2)
curve_2 = Grid.Curve(dropItems)
intersect = Geometry.Intersect(geometry=curve, other=curve_2, lacing=CrossProduct)
levels = Levels("LEVEL 0")
byPointAndLevel = FamilyInstance.ByPointAndLevel(byFamilyNameAndTypeName, intersect, levels)
