# Dynamo graph Select Model Parameters.dyn (Dynamo 0.8.2.2392)

select_model_element = DSModelElementSelection()  # 1 picked in the model
watch = Watch(select_model_element)
select_model_elements = DSModelElementsSelection()  # 5 picked in the model
watch_2 = Watch(select_model_elements)
categories = Categories("StructuralColumns")
all_elements_of_category = ElementsOfCategory(categories)
watch_3 = Watch(all_elements_of_category)
categories_2 = Categories("StructuralFraming")
all_elements_of_category_2 = ElementsOfCategory(categories_2)
watch_4 = Watch(all_elements_of_category_2)
all_family_types_of_category = Custom[All Family Types Of Category](Categories=categories_2)  # Gets all family types/symbols of a given category in the model (does *not *work for system families)
watch_5 = Watch(all_family_types_of_category)
all_families_of_category = Custom[All Families Of Category](Categories=categories_2)  # Gets all famiies of a given category in the model (does *not *work for system families)
watch_6 = Watch(all_families_of_category)
all_families_of_category_2 = Custom[All Families Of Category](Categories=categories)
watch_7 = Watch(all_families_of_category_2)
all_family_types_of_category_2 = Custom[All Family Types Of Category](Categories=categories)
watch_8 = Watch(all_family_types_of_category_2)
levels = Levels("LEVEL 0")
all_elements_at_level = ElementsAtLevel(levels)
watch_9 = Watch(all_elements_at_level)
family = FamilySymbol.Family()
symbol = FamilyInstance.Symbol()
byName = FamilySymbol.ByName()
byFamilySymbol = FamilyInstance.ByFamilySymbol()
name = FamilySymbol.Name()
family_types = FamilyTypes("_BH Generic Face Based Circular Void:1000Ø CIRCULAR VOID")
all_elements_of_family_type = ElementsOfFamilyType(family_types)
watch_10 = Watch(all_elements_of_family_type)
Input = Input()
parameters = Element.Parameters(all_elements_of_category)
parameters_2 = Element.Parameters(all_elements_of_category_2)
string = StringInput("")
getParameterValueByName = Element.GetParameterValueByName(element=all_elements_of_category, parameterName=string)
string_2 = StringInput("")
code_block = CodeBlock { 10; }
setParameterByName = Element.SetParameterByName(element=all_elements_of_category, parameterName=string_2, value=code_block)
code_block_2 = CodeBlock { "Length"; }
