# Dynamo graph 160205 Export Pile Schedule to Excel.dyn (Dynamo 0.8.2.2392)

file_path = Filename("C:\Users\cstone\Desktop\REVIT_PILE_SCHEDULE.xlsx")
code_block = CodeBlock { "Sheet 1"; }
code_block_2 = CodeBlock { 0; }
categories = Categories("StructuralFoundation")
all_elements_of_category = ElementsOfCategory(categories)
string_from_object = FromObject(all_elements_of_category)
code_block_3 = CodeBlock { "R.C. PILE"; }
contains = String.Contains(str=string_from_object, searchFor=code_block_3)
filterByBoolMask = List.FilterByBoolMask(list=all_elements_of_category, mask=contains)
code_block_4 = CodeBlock()
# ---------- code_block_4.designscript (13 lines) ----------
"Mark";
"Pile Radius";
"Pile Diameter";
"Pile Depth";
"Embedment Length";
"Pile Length";
"Estimated Cut-Off Level (m AOD)";
"Estimated Toe Level (m AOD)";
"BH_M_X Real Co-Ordinate";
"BH_M_Y Real Co-Ordinate";
"Material: Name";
"Pile Depth Numerical";
"Embedment Length Numerical";
# ----------------------------------------
create = List.Create(code_block_4.out0, code_block_4.out1, code_block_4.out2, code_block_4.out3, code_block_4.out4, code_block_4.out5, code_block_4.out6, code_block_4.out7, code_block_4.out8, code_block_4.out9, code_block_4.out10, code_block_4.out11, code_block_4.out12)
getParameterValueByName = Element.GetParameterValueByName(element=filterByBoolMask.in, parameterName=create)
writeToFile = Excel.WriteToFile(filePath=file_path, sheetName=code_block, startRow=code_block_2, startCol=code_block_2, data=getParameterValueByName)
get_all_views = Custom[Get All Views]()  # This node will query all views in the model and return them based on category
getTextFromHeader = Custom[Schedule.GetTextFromHeader](ViewSchedule_s=get_all_views.Schedules)  # from Viewschedule input, returns columns header values as text
getCalculatedValues = Custom[Schedule.GetCalculatedValues]()  # Get Schedule Calculated Values from name input
watch = Watch(getCalculatedValues.Value_s)
watch_2 = Watch(get_all_views.Schedules)
input = CodeBlock { ViewSchedule(s); }
code_block_5 = CodeBlock { 11; }
getItemAtIndex = List.GetItemAtIndex(list=get_all_views.Schedules, index=code_block_5)
code_block_6 = CodeBlock(Item=getItemAtIndex) { Flatten({Item}); }
code_block_7 = CodeBlock()  # same code as code_block_4
python_script = Python(IN[0]=code_block_6, IN[1]=code_block_7.out2)
# ---------- python_script.python (59 lines) ----------
#python nodes in dynamo 0.7
#proposed by Julien Benoit @jbenoit44 
#http://aecuandme.wordpress.com/
import clr
clr.AddReference('ProtoGeometry')
from Autodesk.DesignScript.Geometry import *
# Import ToDSType(bool) extension method
clr.AddReference("RevitNodes")
import Revit
clr.ImportExtensions(Revit.Elements)
# Import geometry conversion extension methods
clr.ImportExtensions(Revit.GeometryConversion)
# Import DocumentManager and TransactionManager
clr.AddReference("RevitServices")
import RevitServices
from RevitServices.Persistence import DocumentManager
from RevitServices.Transactions import TransactionManager
from System.Collections.Generic import *
# Import RevitAPI
clr.AddReference("RevitAPI")
import Autodesk
from Autodesk.Revit.DB import *

doc = DocumentManager.Instance.CurrentDBDocument
uiapp = DocumentManager.Instance.CurrentUIApplication
app = uiapp.Application
uidoc=DocumentManager.Instance.CurrentUIApplication.ActiveUIDocument

views = []
for i in IN[0]:
	views.append(UnwrapElement(i))

values=[]
name=IN[1]

# Start Transaction
TransactionManager.Instance.EnsureInTransaction(doc)
for v in views:
	value=[]
	for i in range(100):
		try:
			b=SectionType.Body
			a=v.GetCellText(b,0,i)
		except:
			0
		if a == IN[1]:
			try:
				for n in range(2000):
					c=SectionType.Body
					d=v.GetCellText(b,n,i)
					value.append(d)
			except:
				0		
	values.append(value)
	
# End Transaction
TransactionManager.Instance.TransactionTaskDone()

OUT=values
# ----------------------------------------
isEmpty = List.IsEmpty()
map = List.Map(list=python_script, f_x=isEmpty)
filterByBoolMask_2 = List.FilterByBoolMask(list=python_script, mask=map)
# note: If same Calc val is found in multiple schedule, it will be returned as list of list.
deconstruct = List.Deconstruct()
map_2 = List.Map(list=filterByBoolMask_2.out, f_x=deconstruct.rest)
output = CodeBlock(s=map_2) { Value(s); }
map_3 = List.Map(list=filterByBoolMask_2.out, f_x=deconstruct.first)
output_2 = CodeBlock(s=map_3) { Header(s); }
input_2 = CodeBlock { Calc. Val. Name (string); }
