# Dynamo graph Export Pile Schedule.dyn (Dynamo 0.8.0.950)

file_path = Filename("P:\032458\F04 - Structural\Data\Docs\Revit_drawing_list_export.xlsx")
code_block = CodeBlock { "Sheet1"; }
code_block_2 = CodeBlock { 0; 1; }
categories = Categories("Sheets")
all_elements_of_category = ElementsOfCategory(categories)
code_block_3 = CodeBlock()
# ---------- code_block_3.designscript (10 lines) ----------
"Sheet Number";
"Sheet Name";
"Sheet Rev";
"Sheet Title 1";
"Sheet Title 2";
"Drawn By";
"Checked By";
"Sheet Issue Date";
"Sheet Status";
"Sheet Title 3";
# ----------------------------------------
getParameterValueByName = Element.GetParameterValueByName(element=all_elements_of_category, parameterName=code_block_3.out0)
getParameterValueByName_2 = Element.GetParameterValueByName(element=all_elements_of_category, parameterName=code_block_3.out1)
getParameterValueByName_3 = Element.GetParameterValueByName(element=all_elements_of_category, parameterName=code_block_3.out2)
getParameterValueByName_4 = Element.GetParameterValueByName(element=all_elements_of_category, parameterName=code_block_3.out3)
getParameterValueByName_5 = Element.GetParameterValueByName(element=all_elements_of_category, parameterName=code_block_3.out4)
getParameterValueByName_6 = Element.GetParameterValueByName(element=all_elements_of_category, parameterName=code_block_3.out5)
getParameterValueByName_7 = Element.GetParameterValueByName(element=all_elements_of_category, parameterName=code_block_3.out6)
getParameterValueByName_8 = Element.GetParameterValueByName(element=all_elements_of_category, parameterName=code_block_3.out7)
getParameterValueByName_9 = Element.GetParameterValueByName(element=all_elements_of_category, parameterName=code_block_3.out8)
getParameterValueByName_10 = Element.GetParameterValueByName(element=all_elements_of_category, parameterName=code_block_3.out9)
create = List.Create(getParameterValueByName, getParameterValueByName_2, getParameterValueByName_3, getParameterValueByName_4, getParameterValueByName_5, getParameterValueByName_6, getParameterValueByName_7, getParameterValueByName_8, getParameterValueByName_9, getParameterValueByName_10)
transpose = List.Transpose(create)
writeToFile = Excel.WriteToFile(file_path, code_block, code_block_2.out0, code_block_2.out1, transpose)
