# Dynamo graph Extend Piles to Toposurface.dyn (Dynamo 0.8.2.2392)

categories = Categories("StructuralFoundation")
all_elements_of_category = ElementsOfCategory(categories)
string_from_object = FromObject(all_elements_of_category)
code_block = CodeBlock { "R.C. PILE"; }
contains = String.Contains(str=string_from_object, searchFor=code_block)
filterByBoolMask = List.FilterByBoolMask(list=all_elements_of_category, mask=contains)
string = StringInput("Pile Depth")
location = Custom[Element.Location](Element_s=filterByBoolMask.in)  # Returns the location of an element as an XYZ (or if it's line-based the start and end point of the line), along with some booleans to help filtering the results. Use this for some element types (e.g. walls or lines) that do not work with the built-in Get Family Instance Location node.
flatten = Flatten(location.Points)
categories_2 = Categories("Topography")
all_elements_of_category_2 = ElementsOfCategory(categories_2)
code_block_2 = CodeBlock { 0; }
getItemAtIndex = List.GetItemAtIndex(list=all_elements_of_category_2, index=code_block_2)
mesh = Topography.Mesh(getItemAtIndex)
faceVertices = Custom[Mesh.FaceVertices](Mesh=mesh)  # Gets the vertices of each face of a given mesh
byPerimeterPoints = Surface.ByPerimeterPoints(faceVertices)
code_block_3 = CodeBlock { Vector.ByCoordinates(0,0,-1); }
project = Point.Project(location.Points, byPerimeterPoints, code_block_3, lacing=CrossProduct)
flatten_2 = Flatten(project)
code_block_4 = CodeBlock(a=flatten, b=flatten_2) { z1=a.Z; z2=b.Z; z=z1-z2; }
round = Math.Round(code_block_4.z)
setParameterByName = Element.SetParameterByName(element=filterByBoolMask.in, parameterName=string, value=round)
byStartPointEndPoint = Line.ByStartPointEndPoint(startPoint=flatten, endPoint=flatten_2)
number_slider = DoubleSlider(450, range=0..500 step 10)
add = round + number_slider
