# Dynamo graph Pile Schedule and Annotation.dyn (Dynamo 0.8.2.2392)

categories = Categories("StructuralFoundation")
all_elements_of_category = ElementsOfCategory(categories)
transpose = List.Transpose(all_elements_of_category)
string_from_object = FromObject(transpose)
string = StringInput("R.C. PILE")
contains = String.Contains(str=string_from_object, searchFor=string)
filterByBoolMask = List.FilterByBoolMask(list=transpose, mask=contains)
location = Custom[Element.Location](Element_s=filterByBoolMask.in)  # Returns the location of an element as an XYZ (or if it's line-based the start and end point of the line), along with some booleans to help filtering the results. Use this for some element types (e.g. walls or lines) that do not work with the built-in Get Family Instance Location node.
X = Point.X(location.Points)
Y = Point.Y(location.Points)
code_block = CodeBlock(a=X, b=Y) { 5*a-1*b; }
sortByKeyList = Custom[List.SortByKeyList](keyList=code_block, list=filterByBoolMask.in)  # Reorder a list according to the sorted order of a second key list.
code_block_2 = CodeBlock { "Mark"; }
code_block_3 = CodeBlock { "CP "; "CP "; }
string_from_object_2 = FromObject(sortByKeyList.list)
count = List.Count(string_from_object_2)
numberSequence = BHAnnotations.BHAnnotationTools.NumberSequence(count)
code_block_4 = CodeBlock(reffix=code_block_3.out0, suffix=numberSequence) { reffix + suffix; }
setParameterByName = Element.SetParameterByName(element=sortByKeyList.list, parameterName=code_block_2, value=code_block_4)
getParameterValueByName = Element.GetParameterValueByName(element=sortByKeyList.list, parameterName=code_block_2)
string_2 = StringInput("BH_X")
X_2 = Point.X(location.Points)
setParameterByName_2 = Element.SetParameterByName(element=filterByBoolMask.in, parameterName=string_2, value=X_2)
string_3 = StringInput("BH_Y")
Y_2 = Point.Y(location.Points)
setParameterByName_3 = Element.SetParameterByName(element=filterByBoolMask.in, parameterName=string_3, value=Y_2)
string_4 = StringInput("BH_Z")
Z = Point.Z(location.Points)
setParameterByName_4 = Element.SetParameterByName(element=filterByBoolMask.in, parameterName=string_4, value=Z)
