# Dynamo graph Create Titled Drawing Sheets from Excel.dyn (Dynamo 0.8.0.950)

file_path = Filename("C:\Users\afisher\Desktop\issue sht.xlsx")
fromPath = FileObject(file_path)  # "File.FromPath"
string = StringInput("Sheet1")
readFromFile = Excel.ReadFromFile(fromPath, string)
transpose = List.Transpose(readFromFile)
code_block = CodeBlock { 0; 1; }
getItemAtIndex = List.GetItemAtIndex(list=transpose, index=code_block.out1)
getItemAtIndex_2 = List.GetItemAtIndex(list=transpose, index=code_block.out0)
family_types = FamilyTypes("_Buro Happold - A1:_Buro Happold - A1")
levels = Levels("LEVEL 1")
byLevel = FloorPlanView.ByLevel(levels)
byNameNumberTitleBlockAndView = Sheet.ByNameNumberTitleBlockAndView(getItemAtIndex, getItemAtIndex_2, family_types, byLevel)
