# Dynamo graph Duplicate View as Dependent.dyn (Dynamo 0.8.1.1942)

get_all_views = Custom[Get All Views]()  # This node will query all views in the model and return them based on category
watch = Watch(get_all_views.Engineering_Plans)
code_block = CodeBlock { "View Name"; }
getParameterValueByName = Element.GetParameterValueByName(element=get_all_views.Engineering_Plans, parameterName=code_block)
string_from_object = FromObject(getParameterValueByName)
code_block_2 = CodeBlock { "User Review"; }
boolean = BoolSelector(false)
contains = String.Contains(str=string_from_object, searchFor=code_block_2, ignoreCase=boolean)
filterByBoolMask = List.FilterByBoolMask(list=get_all_views.Engineering_Plans, mask=contains)
duplicateAsDependent = Custom[View.DuplicateAsDependent](View_s=filterByBoolMask.in)  # Duplicates a given view as a dependent view
code_block_3 = CodeBlock { 0; 1; }
getItemAtIndex = List.GetItemAtIndex(list=duplicateAsDependent, index=code_block_3.out0)
code_block_4 = CodeBlock { "View Name"; }
code_block_5 = CodeBlock { "Level 0 - Rotation User Review"; "Level 1 - Rotation User Review"; }
setParameterByName = Element.SetParameterByName(element=getItemAtIndex, parameterName=code_block_4, value=code_block_5.out0)
getItemAtIndex_2 = List.GetItemAtIndex(list=duplicateAsDependent, index=code_block_3.out1)
setParameterByName_2 = Element.SetParameterByName(element=getItemAtIndex_2, parameterName=code_block_4, value=code_block_5.out1)
