# Dynamo graph Duplicate View.dyn (Dynamo 0.8.1.1942)

views = Custom[Document.Views]()  # Gets all views in the document - except for 3D view templates (as long as this bug is not fixed: https://github.com/DynamoDS/Dynamo/issues/2970)
watch = Watch(views)
views_2 = Views("Project View")
string_from_object = FromObject(views)
code_block = CodeBlock { "Documentation"; }
contains = String.Contains(str=string_from_object, searchFor=code_block)
filterByBoolMask = List.FilterByBoolMask(list=views, mask=contains)
flatten = Flatten(filterByBoolMask.in)
duplicateWithDetailing = Custom[View.DuplicateWithDetailing](View_s=flatten)  # Duplicates a given view with detailing
getItemAtIndex = List.GetItemAtIndex(list=flatten)
byName = DraftingView.ByName()
code_block_2 = CodeBlock { "View Name"; }
getParameterValueByName = Element.GetParameterValueByName(element=views, parameterName=code_block_2)
string_from_object_2 = FromObject(getParameterValueByName)
code_block_3 = CodeBlock { "User Review"; }
contains_2 = String.Contains(str=string_from_object_2, searchFor=code_block_3)
filterByBoolMask_2 = List.FilterByBoolMask(list=views, mask=contains_2)
flatten_2 = Flatten(filterByBoolMask_2.in)
code_block_4 = CodeBlock { 5; }
getItemAtIndex_2 = List.GetItemAtIndex(list=flatten_2, index=code_block_4)
duplicateWithDetailing_2 = Custom[View.DuplicateWithDetailing](View_s=getItemAtIndex_2)
