# Dynamo graph Strip all Views and Sheets.dyn (Dynamo 0.8.1.1942)

get_all_views = Custom[Get All Views]()  # This node will query all views in the model and return them based on category
create = List.Create(get_all_views.Renderings, get_all_views.Pressure_Loss_Reports, get_all_views.Panel_Schedules, get_all_views.Walkthroughs, get_all_views.Elevations, get_all_views.Drawing_Sheets, get_all_views.Details, get_all_views.Loads_Reports, get_all_views.Cost_Reports, get_all_views.Legends, get_all_views.3D_Views, get_all_views.Column_Schedules, get_all_views.Internal_Views, get_all_views.Sections, get_all_views.Ceiling_Plans, get_all_views.Schedules, get_all_views.Area_Plans, get_all_views.Reports)
flatten = Flatten(create)
eraser = Custom[Eraser](Element_s=flatten)  # Try to delete element from project by his ID
create_2 = List.Create(get_all_views.Undefined_Views, get_all_views.Floor_Plans, get_all_views.Engineering_Plans)
flatten_2 = Flatten(create_2)
code_block = CodeBlock { "BH View Group"; }
getParameterValueByName = Element.GetParameterValueByName(element=flatten_2, parameterName=code_block)
string_from_object = FromObject(getParameterValueByName)
code_block_2 = CodeBlock { "Documentation"; }
boolean = BoolSelector(false)
contains = String.Contains(str=string_from_object, searchFor=code_block_2, ignoreCase=boolean, lacing=Longest)
filterByBoolMask = List.FilterByBoolMask(list=flatten_2, mask=contains)
eraser_2 = Custom[Eraser](Element_s=filterByBoolMask.out)
eraser_3 = Custom[Eraser](Element_s=filterByBoolMask.in)
